% Simulink data dictionary Interfaces.sldd

ADC_Temp1_T = Simulink.Signal(DataType="single", Unit=" degC")
GPI_Button1_B = Simulink.Signal(DataType="boolean", Unit=" degC")
GPI_Button2_B = Simulink.Signal(DataType="boolean", Unit=" degC")
UART_ExtTemp_T = Simulink.Signal(DataType="single", Unit=" degC")
MOD_Decision1_B = Simulink.Signal(DataType="boolean", Unit=" degC")
GPO_Led1_B = Simulink.Signal(DataType="boolean", Unit=" degC")
GPO_Led2_B = Simulink.Signal(DataType="boolean", Unit=" degC")
MOD_Decision2_B = Simulink.Signal(DataType="boolean", Unit=" degC")